# Grasshopper definition ThermalComfort_GH_Internalized.gh (Grasshopper 1.0.7)

# Created by: Ed May, BLDGtyp, LLC
# Feb 6, 2020
honeybee = Honeybee_Honeybee()  # -> Vviiiiiiiiiizzz; plug-in component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

# ----
# 1. Boundary Conditions
operative_temp_c = Slider(22, range=0..25)
view_factor_resolution_default_0 = Slider(0, range=0..3)
ext_drybulbtemp_c = Slider(-12, range=-15..15)

drybulb_air_temp_c = Slider(22, range=0..25)

# ---- group: Passive House Windows
frame_type = PythonScript(name="PH Frame", frameWidth="150", UValue="1.0", PSI_Spacer="0.033", PSI_Install="0.08")  # -> out, Frame
# ---------- frame_type: Python ----------
Frame_ = [{
    "name":_name, 
    "FrameWidth":float(_frameWidth/1000), 
    "UValue":_UValue,
    "PSIspacer":_PSI_Spacer,
    "PSIinstall":_PSI_Install}]
# ---------- end frame_type ----------
glazing_type = PythonScript(name="PH Glazing", U_COG="0.5")  # -> out, Glazing
# ---------- glazing_type: Python ----------
Glazing_ = [{'name':_name, 'UValue':_U_COG}]
# ---------- end glazing_type ----------

# ---- group: Code Minimum Windows
# 2. Window Components
panel = Panel("NYS ECC 2020")
frame_type_2 = PythonScript(name=panel, frameWidth="150", UValue="2.27", PSI_Spacer="0.00", PSI_Install="0.08")  # -> out, Frame; same code as frame_type
glazing_type_2 = PythonScript(name="NYS ECC Code Min", U_COG="2.27")  # -> out, Glazing; same code as glazing_type

# ----
# 3. Wall Insulation
uninsulated_w_m2_k = Panel("1.670")
insulated_w_m2_k = Panel("0.641")
passive_house_w_m2_k = Panel("0.418")
ladybug = Ladybug_Ladybug()  # -> Vviiiiiiiiiizzz; plug-in component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
data_wall_u_vale = Data(uninsulated_w_m2_k)
data_frame = Data(frame_type_2.Frame)
data_glazing = Data(glazing_type_2.Glazing)
# 3.a Set up the Analysis Geometry
srf_analysis_floor = Surface(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)

# ---- group: FloorPlan Lines
# 3. Set up the Geometry and U-Values
crv_floorplan = Curve([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])

# ----
# 3.d Set up the Window Surfaces
brep_windows = Brep([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])

# ----
# 3.b Set up the Adiabatic Surfaces
srf_i_interior_walls = Surface([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])
data_int_temp = Data(operative_temp_c)
data_int_temp_2 = Data(operative_temp_c)
data_int_temp_3 = Data(operative_temp_c)
srf_ceiling = Surface(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)
srf_floor = Surface(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)
sssrftemp = Ladybug_SteadyStateSurfaceTemperature(outTemp=data_int_temp, inTemp=data_int_temp, uValue="1")  # -> inFilmCoeff, extFilmCoeff, inSrfTemp, extSrfTemp; plug-in component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
sssrftemp_2 = Ladybug_SteadyStateSurfaceTemperature(outTemp=data_int_temp_2, inTemp=data_int_temp_2, uValue="1")  # -> inFilmCoeff, extFilmCoeff, inSrfTemp, extSrfTemp; plug-in component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
sssrftemp_3 = Ladybug_SteadyStateSurfaceTemperature(outTemp=data_int_temp_3, inTemp=data_int_temp_3, uValue="1")  # -> inFilmCoeff, extFilmCoeff, inSrfTemp, extSrfTemp; plug-in component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
list = ValueList({"Wall", "Window", "Roof", "Floor", "Other"}, selected="Roof")
list_2 = ValueList({"Wall", "Window", "Roof", "Floor", "Other"}, selected="Wall")
list_3 = ValueList({"Wall", "Window", "Roof", "Floor", "Other"}, selected="Floor")
dictionarymaker = PythonScript(srfType=list_2, srfList=flatten(srf_i_interior_walls), inSrfTemp=flatten(sssrftemp.inSrfTemp))  # -> out, simplify(DictsOut); inputs srfList: list, inSrfTemp: list
# ---------- dictionarymaker: Python ----------
#EM May 23, 2019
#Brings in some brep geometry and 'tags' each one with 
#a surface temp. Combines the temp and geometry into a dictionary

"""
Brings in some brep geometry and 'tags' each one with a surface temp and a type. Combines the temp, type and geometry into a dictionary
    
    Args:
        _srfType: "Wall", "Window", "Roof', "Floor", "Other"
        _srfList: Flattened list of Breps / surfaces representing the geometry of the building. If its a window surface, be sure to set the'_srfType' to "Window"
        _frameWidth: If you are using this to create a window, input the face frame width (in meters) here
        _inSrfTemp: Connect to the 'InSrfTemp' of the Ladybug 'ssSrfTemp' component. Make sure its 'flattened'
    Returns:
        DictsOut_: The output dictionary for use in the 'SrfcOrganizer'. Combine with other Dics using a Merge. Make sure its 'simplified'
"""

import rhinoscriptsyntax as rs
import ghpythonlib.components as gh

def WindowFrameMaker(defSurface, defFrameWidth, POS):
    # This is used to create the two breps for a window
    # one for the frame and another for the glazing
    a = gh.BrepEdges(defSurface).naked
    b = gh.JoinCurves(a)
    c = gh.OffsetonSrf(b, defFrameWidth, defSurface)
    d = gh.SolidIntersection(defSurface, c)
    e = gh.DeconstructBrep(d)[0]
    return e[POS]

#Clean up inputs
if _frameWidth == None:
    _frameWidth = 0.01

#First, if its a window, call the WindowFrameMaker function and create two surfaces, one for the frame, one for glazing
#And create dictionary entries for each, tag with its surface 'type'
if _srfType == "Window":
    DictsOut_ = []
    for i in range(len(_srfList)):
        #First, get the frame and glass surfaces from the window frame builder
        try:
            frameSrfc = WindowFrameMaker(rs.coercebrep(_srfList[i]),_frameWidth, 0)
            glassSrfc = WindowFrameMaker(rs.coercebrep(_srfList[i]),_frameWidth, 1)
            frameSrfc == True #make sure it worked
            glassSrfc == True
        except:
            print 'Flipping surface'
            #Sometimes has to flip the surface for the offset to work
            frameSrfc = WindowFrameMaker(  gh.Flip(rs.coercebrep(_srfList[i]))[0] ,_frameWidth, 0)
            glassSrfc = WindowFrameMaker(  gh.Flip(rs.coercebrep(_srfList[i]))[0] ,_frameWidth, 1)
        
        #assumes it goes in steps of '3', so multiplies by 3 each time
        DictsOut_.append({
            "srfcObj":rs.coercebrep(_srfList[i]),
            "inTemp":_inSrfTemp[i*3], 
            "srfType":"WinSimple"})# the Simple Window dict Entry
        DictsOut_.append({
            "srfcObj":frameSrfc,
            "inTemp":_inSrfTemp[i*3+1],
            "srfType":"WinFrame"})# the frame Brep dict entry
        DictsOut_.append({
            "srfcObj":glassSrfc,
            "inTemp":_inSrfTemp[i*3+2],
            "srfType":"WinGlazing"})# the Glazing Brep dict entry
# But if its not a window, do the regular dictionary entry creation thing ....
else:
    if len(_inSrfTemp)>1:
        DictsOut_ = []
        for i in range(len(_srfList)):
            DictsOut_.append({"srfcObj":rs.coercebrep(_srfList[i]), "inTemp":_inSrfTemp[i], "srfType":_srfType})
    else:
        DictsOut_ = []
        for i in range(len(_srfList)):
            DictsOut_.append({"srfcObj":rs.coercebrep(_srfList[i]), "inTemp":_inSrfTemp[0], "srfType":_srfType})
# ---------- end dictionarymaker ----------
dictionarymaker_2 = PythonScript(srfType=list, srfList=flatten(srf_ceiling), inSrfTemp=flatten(sssrftemp_2.inSrfTemp))  # -> out, simplify(DictsOut); inputs srfList: list, inSrfTemp: list; same code as dictionarymaker
dictionarymaker_3 = PythonScript(srfType=list_3, srfList=flatten(srf_floor), inSrfTemp=flatten(sssrftemp_3.inSrfTemp))  # -> out, simplify(DictsOut); inputs srfList: list, inSrfTemp: list; same code as dictionarymaker

# ----
# 3.c Set up the Exposed Surfaces
data_ext_design_temp = Data(ext_drybulbtemp_c)
data_wall_u_vale_2 = Data(data_wall_u_vale)
data_int_temp_4 = Data(operative_temp_c)
srf_wall_ext = Surface([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])
sssrftemp_4 = Ladybug_SteadyStateSurfaceTemperature(outTemp=data_ext_design_temp, inTemp=data_int_temp_4, uValue=data_wall_u_vale_2)  # -> inFilmCoeff, extFilmCoeff, inSrfTemp, extSrfTemp; plug-in component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
list_4 = ValueList({"Wall", "Window", "Roof", "Floor", "Other"}, selected="Wall")
dictionarymaker_4 = PythonScript(srfType=list_4, srfList=flatten(srf_wall_ext), inSrfTemp=flatten(sssrftemp_4.inSrfTemp))  # -> out, simplify(DictsOut); inputs srfList: list, inSrfTemp: list; same code as dictionarymaker

data_glazingtype = Data(data_glazing)
data_frame_type = Data(data_frame)
window_u_value = PythonScript(WindowGeometry=brep_windows, frameType=data_frame_type, glazingType=data_glazingtype)  # -> out, frameWidth, u_Values, U_w_Installed, U_f_Installed, U_COG; inputs WindowGeometry: list, frameType: list, glazingType: list, U_w_Installed: list
# ---------- window_u_value: Python ----------
#EM Jan 22, 2020

#Note  - its all in metric values
import ghpythonlib.components as ghLib
import rhinoscriptsyntax as rs

U_w_Installed_ = []
U_f_Installed_ = []
U_COG_ = []

u_Values_ = []


# fix the U-Value installed input on the U-Value to use
if len(_WindowGeometry) == len(_U_w_Installed):
    pass
else:
    if len(_U_w_Installed) > 0:
        uVal = _U_w_Installed[0]
        _U_w_Installed = []
        for i in range(len(_WindowGeometry)):
            _U_w_Installed.append(uVal)

for i in range(len(_WindowGeometry)):
    #Bring in from the 'Type' objects
    Ug = _glazingType[0]['UValue']
    Uf = _frameType[0]['UValue']
    PSIg = _frameType[0]['PSIspacer']
    PSIinst = _frameType[0]['PSIinstall']
    
    #Bring in the geometry of the window
    Aw = ghLib.Area(rs.coercebrep(_WindowGeometry[i])).area
    WinDim1 = ghLib.SegmentLengths(rs.coercebrep(_WindowGeometry[i]))[0]
    WinDim2 = ghLib.SegmentLengths(rs.coercebrep(_WindowGeometry[i]))[2]
    
    #Calculate the missing parameters
    GlassDim1 = WinDim1 - ((float(_frameType[0]['FrameWidth'])*2))
    GlassDim2 = WinDim2 - ((float(_frameType[0]['FrameWidth'])*2))
    Ag = float(GlassDim1 * GlassDim2)
    Af = Aw - Ag
    LenG = (GlassDim1*2) +(GlassDim2*2)
    LenInst = (WinDim1*2) + (WinDim2)
    
    #Calculate the U-w-Installed (W/m2-k)
    if len(_U_w_Installed) == 0:
        U_w_Installed_.append(((Ug * Ag) + (Uf * Af) + (PSIg * LenG) + (PSIinst * LenInst)) / Aw )
    else:
        U_w_Installed_.append(_U_w_Installed[i])
    
    U_f_Installed_.append(((Uf * Af) + (PSIg * LenG) + (PSIinst * LenInst)) / Af)
    
    
    frameWidth_ = _frameType[0]['FrameWidth']
    U_COG_.append(_glazingType[0]['UValue'])



#Weave the data togerher in the right order
for i in range(len(_WindowGeometry)):
    u_Values_.append(U_w_Installed_[i])
    u_Values_.append(U_f_Installed_[i])
    u_Values_.append(U_COG_[i])


"""
print "GlassDim1 "+ str(GlassDim1)
print "GlassDim2 "+ str(GlassDim2)
print "Ug "+str(Ug)
print "Uf "+str(Uf)
print "Ag "+str(Ag)
print "Af "+str(Af)
print "Aw "+str(Aw)
"""
# ---------- end window_u_value ----------
data_ext_design_temp_2 = Data(ext_drybulbtemp_c)

# ---- group: Analysis Grid Size
panel_2 = Panel("2")

# ----
data_int_temp_5 = Data(operative_temp_c)

# ---- group: Create test points for 'normal' Evaluation
m_a_f_f = Panel("0.6")
genmesh = Ladybug_GenerateMesh(testGeometry=srf_analysis_floor, gridSize=panel_2, distBaseSrf=m_a_f_f, moveTestMesh=Toggle(False))  # -> readMe, simplify(testPoints), simplify(ptsVectors), simplify(facesArea), simplify(mesh); plug-in component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

# ---- group: Create test points for Horizontal Downdraft (0.10m)
m_a_f_f_2 = Panel("0.1")
genmesh_2 = Ladybug_GenerateMesh(testGeometry=srf_analysis_floor, gridSize=panel_2, distBaseSrf=m_a_f_f_2, moveTestMesh=Toggle(False))  # -> readMe, simplify(testPoints), simplify(ptsVectors), simplify(facesArea), simplify(mesh); plug-in component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

# ----
sssrftemp_5 = Ladybug_SteadyStateSurfaceTemperature(outTemp=data_ext_design_temp_2, inTemp=data_int_temp_5, uValue=flatten(window_u_value.u_Values))  # -> inFilmCoeff, extFilmCoeff, flatten(inSrfTemp), extSrfTemp; plug-in component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
list_5 = ValueList({"Wall", "Window", "Roof", "Floor", "Other"}, selected="Window")
dictionarymaker_5 = PythonScript(
    srfType=list_5,
    srfList=flatten(brep_windows),
    frameWidth=window_u_value.frameWidth,
    inSrfTemp=flatten(sssrftemp_5.inSrfTemp))  # -> out, simplify(DictsOut); inputs srfList: list, inSrfTemp: list
# ---------- dictionarymaker_5: Python ----------
#EM May 23, 2019
#Brings in some brep geometry and 'tags' each one with 
#a surface temp. Combines the temp and geometry into a dictionary

"""
Brings in some brep geometry and 'tags' each one with a surface temp and a type.
Combines the temp, type and geometry into a dictionary
    
    Args:
        _srfType: "Wall", "Window", "Roof', "Floor", "Other"
        _srfList: Flattened list of Breps / surfaces representing the geometry of the building. If its a window surface, be sure to set the'_srfType' to "Window"
        _frameWidth: If you are using this to create a window, input the face frame width (in meters) here
        _inSrfTemp: Connect to the 'InSrfTemp' of the Ladybug 'ssSrfTemp' component. Make sure its 'flattened'
    Returns:
        DictsOut_: The output dictionary for use in the 'SrfcOrganizer'. Combine with other Dics using a Merge. Make sure its 'simplified'
"""

import rhinoscriptsyntax as rs
import ghpythonlib.components as gh

def WindowFrameMaker(defSurface, defFrameWidth, POS):
    # This is used to create the two breps for a window
    # one for the frame and another for the glazing
    a = gh.BrepEdges(defSurface).naked
    b = gh.JoinCurves(a, preserve=False)
    c = gh.OffsetonSrf(b, defFrameWidth, defSurface)
    d = gh.BoundarySurfaces(c)  # The glazing surface
    e = gh.SolidIntersection(defSurface, d) # The Frame Surface
    f = gh.DeconstructBrep(e).faces
    
    surfaces = [f, d]
    return surfaces[POS]

#Clean up inputs
if _frameWidth == None:
    _frameWidth = 0.01

#First, if its a window, call the WindowFrameMaker function and create two surfaces, one for the frame, one for glazing
#And create dictionary entries for each, tag with its surface 'type'
if _srfType == "Window":
    DictsOut_ = []
    for i in range(len(_srfList)):
        #First, get the frame and glass surfaces from the window frame builder
        try:
            frameSrfc = WindowFrameMaker(rs.coercebrep(_srfList[i]),_frameWidth, 0)
            glassSrfc = WindowFrameMaker(rs.coercebrep(_srfList[i]),_frameWidth, 1)
            frameSrfc == True #make sure it worked
            glassSrfc == True
        except:
            print 'Flipping surface'
            #Sometimes has to flip the surface for the offset to work
            frameSrfc = WindowFrameMaker(  gh.Flip(rs.coercebrep(_srfList[i]))[0] ,_frameWidth, 0)
            glassSrfc = WindowFrameMaker(  gh.Flip(rs.coercebrep(_srfList[i]))[0] ,_frameWidth, 1)
        
        #assumes it goes in steps of '3', so multiplies by 3 each time
        DictsOut_.append({
            "srfcObj":rs.coercebrep(_srfList[i]),
            "inTemp":_inSrfTemp[i*3], 
            "srfType":"WinSimple"})# the Simple Window dict Entry
        DictsOut_.append({
            "srfcObj":frameSrfc,
            "inTemp":_inSrfTemp[i*3+1],
            "srfType":"WinFrame"})# the frame Brep dict entry
        DictsOut_.append({
            "srfcObj":glassSrfc,
            "inTemp":_inSrfTemp[i*3+2],
            "srfType":"WinGlazing"})# the Glazing Brep dict entry
# But if its not a window, do the regular dictionary entry creation thing ....
else:
    if len(_inSrfTemp)>1:
        DictsOut_ = []
        for i in range(len(_srfList)):
            DictsOut_.append({"srfcObj":rs.coercebrep(_srfList[i]), "inTemp":_inSrfTemp[i], "srfType":_srfType})
    else:
        DictsOut_ = []
        for i in range(len(_srfList)):
            DictsOut_.append({"srfcObj":rs.coercebrep(_srfList[i]), "inTemp":_inSrfTemp[0], "srfType":_srfType})
# ---------- end dictionarymaker_5 ----------
testpointlocation_1_0m = Point(flatten(genmesh.testPoints))
# Note; As per ASHRAE 55 (7.2.2): For Radiant Asymmetry calc the analaysis plane for seated occupants to be 0.6m, for standing occupants to be 1.1m
data_analysis_mesh = Data(genmesh.mesh)
testpointlocation_0_1m = Point(flatten(genmesh_2.testPoints))
merge = Merge(
    Data1=dictionarymaker.DictsOut,
    Data2=dictionarymaker_2.DictsOut,
    Data3=dictionarymaker_3.DictsOut,
    Data4=dictionarymaker_4.DictsOut,
    Data5=dictionarymaker_5.DictsOut)  # -> flatten(Result)
# Set the 'Window Mode'
# 'Simple' is basicaly the same as the PHPP method
# where all the window parameters are combined
# into a single Uw-installed
# 'Detailed' draws all the actual frames and glass and gives
# difference surface temps to each face
list_6 = ValueList({"Simple", "Detailed"}, selected="Simple")
srfcorganizer = PythonScript(WindowMethod=list_6, InputDicts=flatten(merge))  # -> out, OutputTemps, OutputFaces, WinSimpleTemps, WindSimpleFaces, FloorTemps, FloorFaces, WallTemps, WallFaces; inputs InputDicts: list
# ---------- srfcorganizer: Python ----------
#EM May 24, 2019


#Pulls the Breps out from the Dictionary into a single list
#Two different methods, depending on how the windows are done ('simple' or 'detailed')
if _WindowMethod == "Simple":
    OutputFaces_ = []
    for i in range(len(_InputDicts)):
        if _InputDicts[i]["srfType"] != "WinFrame":
            if _InputDicts[i]["srfType"] != "WinGlazing":
                OutputFaces_.append(_InputDicts[i]["srfcObj"])
    OutputTemps_ = []
    for j in range(len(_InputDicts)):
        if _InputDicts[j]["srfType"] != "WinFrame":
            if _InputDicts[j]["srfType"] != "WinGlazing":
                OutputTemps_.append(_InputDicts[j]["inTemp"])
elif _WindowMethod == "Detailed":
    OutputFaces_ = []
    for i in range(len(_InputDicts)):
        if _InputDicts[i]["srfType"] != "WinSimple":
            OutputFaces_.append(_InputDicts[i]["srfcObj"])
    OutputTemps_ = []
    for j in range(len(_InputDicts)):
        if _InputDicts[j]["srfType"] != "WinSimple":
            OutputTemps_.append(_InputDicts[j]["inTemp"])



# This part creates a set of ONLY the windows for use in the
# ankle airspeed analysis function 
WinSimpleTemps_ = []
WindSimpleFaces_ = []
for k in range(len(_InputDicts)):
    if _InputDicts[k]["srfType"] == "WinSimple":
        WinSimpleTemps_.append(_InputDicts[k]["inTemp"])
        WindSimpleFaces_.append(_InputDicts[k]["srfcObj"])

#This part splits out the walls and the floor surfaces for use
#in the warm/cool floor temp calc. 
FloorTemps_ = []
FloorFaces_ = []
WallTemps_ = []
WallFaces_ = []
for j in range(len(_InputDicts)):
    if _InputDicts[j]["srfType"] == "Floor":
        FloorTemps_.append(_InputDicts[j]["inTemp"])
        FloorFaces_.append(_InputDicts[j]["srfcObj"])
    elif _InputDicts[j]["srfType"] == "Wall":
        WallTemps_.append(_InputDicts[j]["inTemp"])
        WallFaces_.append(_InputDicts[j]["srfcObj"])
# ---------- end srfcorganizer ----------
# 4. Runs the Simulations
run_simulation = BooleanToggle(False)

# ----
# Percent Persons Disatisfied (PPD)
data_view_factor_resolution = Data(view_factor_resolution_default_0)
data_test_points = Data(testpointlocation_1_0m)
srfviewfactors = Ladybug_SurfaceViewAnalysis(
    testPtsOrPlanes=flatten(data_test_points),
    testSrfs=srfcorganizer.OutputFaces,
    viewResolution=data_view_factor_resolution,
    parallel=Toggle(True),
    runIt=run_simulation)  # -> readMe, srfViewFactors, viewVecSrfIndex, viewVectors, viewPatches, viewPatchBasePt; plug-in component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
mrt = Ladybug_MRTCalculator(temperatures=srfcorganizer.OutputTemps, viewFactors=srfviewfactors.srfViewFactors)  # -> MRT; plug-in component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
data_dryblub_air_temp = Data(drybulb_air_temp_c)
bool_runit = Boolean(run_simulation)
pmvcomfortcalculator = Ladybug_PMVComfortCalculator(
    dryBulbTemperature=data_dryblub_air_temp,
    meanRadiantTemperature=mrt,
    windSpeed="0.05",
    relativeHumidity="50",
    metabolicRate="1",
    clothingLevel="1",
    calcBalanceTemperature=False,
    runIt=bool_runit)  # -> readMe, port, predictedMeanVote, percentPeopleDissatisfied, standardEffectiveTemperature, port_2, comfortableOrNot, percentOfTimeComfortable, port_3, balanceTemperature; plug-in component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

# ----
# Preview Srfc Temps
demesh = DeconstructMesh(Mesh=srfcorganizer.OutputFaces)  # -> Vertices, Faces, Colours, Normals
lng = ListLength(List=demesh.Faces)
repeat = RepeatData(Data=graft(srfcorganizer.OutputTemps), Length=lng)  # -> flatten(Data)
mjoin = MeshJoin(Meshes=srfcorganizer.OutputFaces)
recolormesh = Ladybug_RecolorMesh(analysisResult=repeat, inputMesh=mjoin)  # -> readMe, newMesh, newLegend, legendBasePt, meshColors, legendColors; plug-in component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

# ---- group: Label
evalsrf = EvaluateSurface(Surface=reparameterize(srfcorganizer.OutputFaces), Point="0.5,0.5")  # -> Point, Normal, UDirection, VDirection, Frame
f = GhPythonScript(in=srfcorganizer.OutputTemps)  # -> out; inputs in: list
# ---------- f: Python ----------
out_ = []
for each in _in:
    out_.append('{:.1f}'.format(each))
# ---------- end f ----------
tag = TextTag(Location=evalsrf.Point, Text=f)

# ---- group: Colored Mesh | PPD
data_analysis_values = Data(pmvcomfortcalculator.percentPeopleDissatisfied)
data_analysis_mesh_2 = Data(data_analysis_mesh)
legendpar = Ladybug_LegendParameters(lowBound="5", highBound="15", decimalPlaces="1")  # -> legendPar; plug-in component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
recolormesh_2 = Ladybug_RecolorMesh(
    analysisResult=data_analysis_values,
    inputMesh=data_analysis_mesh_2,
    legendPar=legendpar,
    analysisTitle="Percent Persons Disatisfied (PPD)",
    legendTitle="PPD %")  # -> readMe, newMesh, newLegend, legendBasePt, meshColors, legendColors; plug-in component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

# ---- group: Show Wireframe of Surface Geom.
data_analysis_geometry = Data(srfcorganizer.OutputFaces)
wires = BrepWireframe(Brep=data_analysis_geometry, Density=-1)
preview = CustomPreview(Geometry=wires, Shader=ColourSwatch(SwatchColor=RGB(166, 0, 255)))

# ---- group: Show Geometry Surfaces
# 5. Display The Results
srf_walls = Surface(srfcorganizer.WallFaces)
srf_windows = Surface(srfcorganizer.WindSimpleFaces)
preview_2 = CustomPreview(Geometry=srf_walls, Shader=ColourSwatch(SwatchColor=RGBA(181, 181, 181, 140)))
preview_3 = CustomPreview(Geometry=srf_windows, Shader=ColourSwatch(SwatchColor=RGBA(129, 210, 235, 140)))

# ---- group: Bake Results
mesh2hatch = Ladybug_MeshToHatch(mesh=recolormesh_2.newMesh, layerName="Result_PPD", runIt=Button())  # -> readMe; plug-in component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
