# Grasshopper definition Psi_Calc_Example_191114+[Internalized].gh (Grasshopper 0.9.76)
# plug-ins: Python Interpreter

ladybug = Ladybug_Ladybug()  # -> Vviiiiiiiiiizzz; plug-in component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
# BC Temps
honeybee = Honeybee_Honeybee()  # -> Vviiiiiiiiiizzz; plug-in component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

rsi_m2_k_w = Panel("0.10")
# Interior Boundary Conditions
name = Panel("Interior_Normal_Horizontal")
interior_temp_c = Panel("20")
rsi_m2_k_w_2 = Panel("0.13")
rsi_m2_k_w_3 = Panel("0.17")
expression = Expression(x=rsi_m2_k_w, Expression="1/x")
expression_2 = Expression(x=rsi_m2_k_w_2, Expression="1/x")
expression_3 = Expression(x=rsi_m2_k_w_3, Expression="1/x")
int_horiz_hf_w_m2_k = Panel(expression_2)
int_upward_hf_w_m2_k = Panel(expression)
int_downward_hf_w_m2_k = Panel(expression_3)
data_bc_name = Data(name)
data_int_temp = Data(interior_temp_c)

# ----
# Materials
panel = Panel("Wood_Coniferous_(Softwood)")
w_m_k = Panel("0.14019")
w_m_k_2 = Panel("0.03981")
w_m_k_3 = Panel("0.16961")
w_m_k_4 = Panel("0.11942")
w_m_k_5 = Panel("60")
w_m_k_6 = Panel("0.02885")
thermmaterial = Honeybee_ThermMaterial(materialName=panel, conductivity=w_m_k)  # -> thermMaterial; plug-in component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
thermmaterial_2 = Honeybee_ThermMaterial(materialName="Cellulose_(Denspack)", conductivity=w_m_k_2)  # -> thermMaterial; plug-in component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
thermmaterial_3 = Honeybee_ThermMaterial(materialName="GWB_(Typ)", conductivity=w_m_k_3)  # -> thermMaterial; plug-in component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
thermmaterial_4 = Honeybee_ThermMaterial(materialName="Plywood_(Typ)", conductivity=w_m_k_4)  # -> thermMaterial; plug-in component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
thermmaterial_5 = Honeybee_ThermMaterial(materialName="Steel_(Plain Carbon)", conductivity=w_m_k_5)  # -> thermMaterial; plug-in component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
thermmaterial_6 = Honeybee_ThermMaterial(materialName="XPS_Foam", conductivity=w_m_k_6)  # -> thermMaterial; plug-in component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

# ----
# Exterior Boundary Condition
name_2 = Panel("Exterior_Normal")
exterior_temp_c = Panel("-10")
rse_m2_k_w = Panel("0.04")
expression_4 = Expression(x=rse_m2_k_w, Expression="1/x")
ext_hf_w_m2_k = Panel(expression_4)
data_ext_temp = Data(exterior_temp_c)
data_bc_name_2 = Data(name_2)

working_directory = Panel("C:\Therm_191113")
# SIMPLE 1-ELEMENT EXAMPLE
data_working_dir = Data(working_directory)
# 1a. Assign Materials: Full Detail
data_mat_softwood = Data(thermmaterial)  # disabled
data_mat_softwood_2 = Data(thermmaterial)  # disabled
data_mat_gwb = Data(thermmaterial_3)  # disabled
data_mat_steel = Data(thermmaterial_5)  # disabled
data_mat_gwb_2 = Data(thermmaterial_3)  # disabled
crv = Curve(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)  # disabled
crv_2 = Curve([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])  # disabled
# 1b. Assign Materials: Clear Field Element 1
crv_3 = Curve(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)  # disabled
crv_4 = Curve([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])  # disabled
crv_5 = Curve(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)  # disabled
createthermpolygons = Honeybee_CreateThermPolygons(geometry=crv_4, material=data_mat_softwood)  # -> readMe, simplify(thermPolygon); disabled; plug-in component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
createthermpolygons_2 = Honeybee_CreateThermPolygons(geometry=crv, material=data_mat_gwb)  # -> readMe, simplify(thermPolygon); disabled; plug-in component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
createthermpolygons_3 = Honeybee_CreateThermPolygons(geometry=crv_2, material=data_mat_steel)  # -> readMe, simplify(thermPolygon); disabled; plug-in component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
createthermpolygons_4 = Honeybee_CreateThermPolygons(geometry=crv_3, material=data_mat_softwood_2)  # -> readMe, simplify(thermPolygon); disabled; plug-in component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
createthermpolygons_5 = Honeybee_CreateThermPolygons(geometry=crv_5, material=data_mat_gwb_2)  # -> readMe, simplify(thermPolygon); disabled; plug-in component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
data_mat_xps_foam = Data(thermmaterial_6)  # disabled
data_mat_cellulose = Data(thermmaterial_2)  # disabled
data_mat_cellulose_2 = Data(thermmaterial_2)  # disabled
data_mat_plywood = Data(thermmaterial_4)  # disabled
data_mat_plywood_2 = Data(thermmaterial_4)  # disabled
crv_6 = Curve([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])  # disabled
crv_7 = Curve(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)  # disabled
crv_8 = Curve(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)  # disabled
crv_9 = Curve([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])  # disabled
crv_10 = Curve(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)  # disabled
createthermpolygons_6 = Honeybee_CreateThermPolygons(geometry=crv_7, material=data_mat_plywood)  # -> readMe, simplify(thermPolygon); disabled; plug-in component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
createthermpolygons_7 = Honeybee_CreateThermPolygons(geometry=crv_8, material=data_mat_xps_foam)  # -> readMe, simplify(thermPolygon); disabled; plug-in component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
createthermpolygons_8 = Honeybee_CreateThermPolygons(geometry=crv_9, material=data_mat_cellulose_2)  # -> readMe, simplify(thermPolygon); disabled; plug-in component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
createthermpolygons_9 = Honeybee_CreateThermPolygons(geometry=crv_10, material=data_mat_plywood_2)  # -> readMe, simplify(thermPolygon); disabled; plug-in component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
createthermpolygons_10 = Honeybee_CreateThermPolygons(geometry=crv_6, material=data_mat_cellulose)  # -> readMe, simplify(thermPolygon); disabled; plug-in component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
entwine = Entwine(
    Branch00=createthermpolygons.thermPolygon,
    Branch01=createthermpolygons_10.thermPolygon,
    Branch02=createthermpolygons_2.thermPolygon,
    Branch03=createthermpolygons_6.thermPolygon,
    Branch04=createthermpolygons_3.thermPolygon,
    Branch05=createthermpolygons_7.thermPolygon,
    FlattenInputs=True)  # disabled
entwine_2 = Entwine(
    Branch00=createthermpolygons_4.thermPolygon,
    Branch01=createthermpolygons_8.thermPolygon,
    Branch02=createthermpolygons_5.thermPolygon,
    Branch03=createthermpolygons_9.thermPolygon,
    FlattenInputs=True)  # disabled
data_therm_polygons = Data(entwine)  # disabled
data_therm_polygons_2 = Data(entwine_2)  # disabled
crv_ext_boundary_element_01 = Curve(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)  # disabled
# 2a. Apply BCs: Full Detail
# Input the boundary edges as
# curves in the scene
crv_int_boundary = Curve(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)  # disabled
crv_ext_boundary_detail = Curve(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)  # disabled
# 2b. Apply BCs: Full Detail
crv_int_boundary_2 = Curve(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)  # disabled
panel_2 = Panel("Ext_Full_Detail")  # disabled
panel_3 = Panel("Ext_Clearfield_Element1")  # disabled
data_film_coefficient = Data(int_horiz_hf_w_m2_k)  # disabled
data_film_coefficient_2 = Data(ext_hf_w_m2_k)  # disabled
data_film_coefficient_3 = Data(int_horiz_hf_w_m2_k)  # disabled
data_film_coefficient_4 = Data(ext_hf_w_m2_k)  # disabled
data_ext_temp_2 = Data(data_ext_temp)  # disabled
data_ext_temp_3 = Data(data_ext_temp)  # disabled
data_bc_name_3 = Data(data_bc_name)  # disabled
data_bc_name_4 = Data(data_bc_name_2)  # disabled
data_bc_name_5 = Data(data_bc_name)  # disabled
data_bc_name_6 = Data(data_bc_name_2)  # disabled
data_inttemp = Data(data_int_temp)  # disabled
data_inttemp_2 = Data(data_int_temp)  # disabled
createthermboundaries = Honeybee_CreateThermBoundaries(boundaryCurve=crv_int_boundary, name=data_bc_name_3, temperature=data_inttemp, filmCoefficient=data_film_coefficient)  # -> readMe, simplify(thermBoundary); disabled; plug-in component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
createthermboundaries_2 = Honeybee_CreateThermBoundaries(
    boundaryCurve=crv_int_boundary_2,
    name=data_bc_name_5,
    temperature=data_inttemp_2,
    filmCoefficient=data_film_coefficient_3)  # -> readMe, simplify(thermBoundary); disabled; plug-in component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
createthermboundaries_3 = Honeybee_CreateThermBoundaries(
    boundaryCurve=crv_ext_boundary_element_01,
    name=data_bc_name_6,
    temperature=data_ext_temp_3,
    filmCoefficient=data_film_coefficient_4,
    uFactorTag=panel_3)  # -> readMe, simplify(thermBoundary); disabled; plug-in component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
createthermboundaries_4 = Honeybee_CreateThermBoundaries(
    boundaryCurve=crv_ext_boundary_detail,
    name=data_bc_name_4,
    temperature=data_ext_temp_2,
    filmCoefficient=data_film_coefficient_2,
    uFactorTag=panel_2)  # -> readMe, simplify(thermBoundary); disabled; plug-in component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

# ----
# Preview:
data_input = Data(crv_int_boundary)  # disabled
end = EndPoints(Curve=data_input)  # -> Start, End; disabled
panel_4 = Panel("0.005")  # disabled
pipe = Pipe(Curve=data_input, Radius=panel_4, Caps=0)  # disabled

data_bc_ext_detail = Data(createthermboundaries_4.thermBoundary)  # disabled
# This part calculates the THERM result for
#  your 'Full Detail' - that is: the actal detail
# with all the bridging elements present.
data_bc_int = Data(createthermboundaries.thermBoundary)  # disabled
# This part calculates the THERM result for
# your 'Clearfield' element - the imaginary
# 'idealized' wall / roof / floor assembly as
# its seen by the U-Value which you'd use in
# the planar energy model
data_bc_ext_element_01 = Data(createthermboundaries_2.thermBoundary)  # disabled
data_bc_ext_element_01_2 = Data(createthermboundaries_3.thermBoundary)  # disabled
toggle = BooleanToggle(False)  # disabled

# ----
# 3a. Full Detail: Run it...
panel_5 = Panel("Example_1Element_FullDetail")  # disabled
data_them_polygons = Data(data_therm_polygons)  # disabled
data_working_dir_2 = Data(data_working_dir)  # disabled
toggle_2 = BooleanToggle(True)  # disabled
data_bc_ext = Data(data_bc_ext_detail)  # disabled
data_bc_int_2 = Data(data_bc_int)  # disabled
writetherm = Honeybee_WriteTHERMFile(
    polygons=flatten(data_them_polygons),
    boundaries=flatten([data_bc_int_2, data_bc_ext]),
    workingDir=data_working_dir_2,
    fileName=panel_5,
    writeTHMFile=toggle_2,
    runTHERM=toggle)  # -> readMe, thermFile, resultFile, uFactorFile, port, probRegion; disabled; plug-in component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
toggle_3 = BooleanToggle(True)  # disabled
list = ValueList({"Temp": 0, "Heat Flux": 1}, selected="Temp")  # disabled
readtherm = Honeybee_ReadTHERMResult(
    resultFile=writetherm.resultFile,
    uFactorFile=writetherm.uFactorFile,
    thermFile=writetherm.thermFile,
    dataType=list,
    SIorIP=toggle_3,
    runIt=toggle_3)  # -> uFactorTags, uFactors, uFactorLength, deltaT, meshValues, meshPoints, coloredMesh, legend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; disabled; plug-in component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

# ----
# Set this one to "Ext_Detail -Total Length"
# Set this one to "Ext_Element01_Roof - Total Length"
# Set this one to "Ext_Element02_Wall - Total Length"
toggle_4 = BooleanToggle(False)  # disabled

# ----
# 3b. Clearfield Element: Run it...
panel_6 = Panel("Example_1Element_Element1")  # disabled
data_them_polygons_2 = Data(data_therm_polygons_2)  # disabled
data_working_dir_3 = Data(data_working_dir)  # disabled
toggle_5 = BooleanToggle(True)  # disabled
data_bc_ext_2 = Data(data_bc_ext_element_01_2)  # disabled
data_bc_int_3 = Data(data_bc_ext_element_01)  # disabled
writetherm_2 = Honeybee_WriteTHERMFile(
    polygons=flatten(data_them_polygons_2),
    boundaries=flatten([data_bc_int_3, data_bc_ext_2]),
    workingDir=data_working_dir_3,
    fileName=panel_6,
    writeTHMFile=toggle_5,
    runTHERM=toggle_4)  # -> readMe, thermFile, resultFile, uFactorFile, port, probRegion; disabled; plug-in component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
toggle_6 = BooleanToggle(True)  # disabled
list_2 = ValueList({"Temp": 0, "Heat Flux": 1}, selected="Temp")  # disabled
readtherm_2 = Honeybee_ReadTHERMResult(
    resultFile=writetherm_2.resultFile,
    uFactorFile=writetherm_2.uFactorFile,
    thermFile=writetherm_2.thermFile,
    dataType=list_2,
    SIorIP=toggle_6,
    runIt=toggle_6)  # -> uFactorTags, uFactors, uFactorLength, deltaT, meshValues, meshPoints, coloredMesh, legend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; disabled; plug-in component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

mesh = Mesh(readtherm.coloredMesh)  # disabled
mesh_2 = Mesh(readtherm_2.coloredMesh)  # disabled
# Draw the curve which represents the
# total length over which the idealized
# clearfield U-Value is included
crv_element_1 = Curve(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)  # disabled
# 4. Calculate the Psi-Value
# Calculate the actual heat loss (W/m) for the
# detail being modeled, including all the bridging
# elements
heat_loss = PythonScript(
    uFactorTags=readtherm.uFactorTags,
    uFactors=readtherm.uFactors,
    uFactorLengths=readtherm.uFactorLength,
    deltaT=readtherm.deltaT)  # -> out, boundary_crv, heatLoss; inputs uFactorTags: tree, uFactors: tree, uFactorLengths: tree, deltaT: tree; disabled
# ---------- heat_loss: Python ----------
#Ed May Sept 17, 2019

"""
Calculator for heat loss values from THERM element (W)
    
    Args:
        _uFactorTags: Tree Input. Connect to the 'uFactorTags' output on the 'readTHERM' component
        _uFactors: Tree Input. Connect to the 'uFactors' output on the 'readTHERM' component
        _uFactorLengths: Tree Input. For the 'Full Detail', simple connect to the 'uFactorLengths' output on the 'readTHERM' component to take in a list of U-factor lengths (mm). 
        For a single 'element', input the length of that element in the 'Full-Detail'. Ensure input is in mm.
        Will also accept a CURVE as input and will compute the length automatically. 'Preview' to see the curve being used for the calculation.
        _deltaT: Tree Input. Connect to the 'uFactorDeltaT' output pon the 'readTHERM' component to take in a list of U-factor temperature differeneces (deg. C).
    Returns:
        heatLoss_: [W/m = U-Factor x Total Length x DeltaT ] Total Heat Loss calculated using the 'Total Length' U-Factor and Length from THERM result.
"""

from System import Object
from Grasshopper import DataTree
from Grasshopper.Kernel.Data import GH_Path
import rhinoscriptsyntax as rs
import Rhino as Rhino
import ghpythonlib.components as gh


class HeatLossElement:
    # To hold onto data for a Heat Loss Element
    
    def __init__(self):
        pass
    
    pass

# pre-set some varaibles
hlElements = []
crv_length_mm = None

if len(_uFactorLengths.Branch(0)) == 6:
    # If its a 6 item list input, its coming from the Honeybee compo. So let it pass
    pass
else:
    # If its gemoetry (A Curve) being input, find the length of it
    try:
        crv = rs.coercecurve(_uFactorLengths.Branch(0)[0])
        crv_length_mm = gh.Length(crv)*1000
        print crv_length_mm
        boundary_crv_ = gh.Pipe(crv, 0.01)
        print 'Found Curve Input. It is {} mm long'.format(crv_length_mm)
    except:
        print 'Somethinge went wrong. Not sure what is input in the _uFactorLength?'

# Actual Heat Loss
# Look at each item coming in
for i in range(len(_uFactorTags.Branches)):
    
    # Create a new Heat Loss Element from input values
    hlObj = HeatLossElement()
    hlObj.DELTAT = _deltaT.Branch(i)[0]
    
    for j in range(len(_uFactorTags.Branch(i))):
        if _uFactorTags.Branch(i)[j].split(" - ")[1] == "Total length":
            hlObj.NAME =  _uFactorTags.Branch(i)[j].split(" - ")[0]
            hlObj.UFACTOR_ACTUAL = float(_uFactors.Branch(i)[j])
            
            # Depending on the Length Input Type....
            if boundary_crv_ == None:
                # If its Honeybee input Tree, use that.
                hlObj.LENGTH_ACTUAL = float(_uFactorLengths.Branch(i)[j]) / 1000 # convert to m
            else:
                # If its a curve, use the length
                hlObj.LENGTH_ACTUAL = crv_length_mm / 1000 
            
            hlObj.HEATLOSS_ACTUAL = hlObj.UFACTOR_ACTUAL * hlObj.LENGTH_ACTUAL * hlObj.DELTAT
    hlElements.append(hlObj)

for element in hlElements:
    print "{0} W/m2k U-Value x {1} m in detail".format(hlObj.UFACTOR_ACTUAL, hlObj.LENGTH_ACTUAL)
    print "{0} Heat Loss: {1} (W/m)".format(element.NAME, element.HEATLOSS_ACTUAL)
    print "{0} U-Value: {1} (W/m2k)".format(element.NAME, element.UFACTOR_ACTUAL)

heatLoss_ = element.HEATLOSS_ACTUAL
# ---------- end heat_loss ----------
# Calculate the heat loss (W/m) for the 'idealized' clearfield U-Factor over
# its length found in the 'FULL DETAIL'
heat_loss_2 = PythonScript(
    uFactorTags=readtherm_2.uFactorTags,
    uFactors=readtherm_2.uFactors,
    uFactorLengths=crv_element_1,
    deltaT=readtherm_2.deltaT)  # -> out, boundary_crv, heatLoss; inputs uFactorTags: tree, uFactors: tree, uFactorLengths: tree, deltaT: tree; disabled; same code as heat_loss
heat_loss_w_m = Panel(heat_loss.heatLoss)  # disabled
heat_loss_w_m_2 = Panel(heat_loss_2.heatLoss)  # disabled
# Then just calc the Psi-Value by finding the
# difference between the 'Actual' heat loss and
# the 'Prediced' heat loss from the 'idealized' Assemblies
psi_value = PythonScript(fullDetail_HL=heat_loss.heatLoss, clearfield_HL=heat_loss_2.heatLoss, deltaT=readtherm.deltaT)  # -> out, PsiValue; inputs clearfield_HL: list; disabled
# ---------- psi_value: Python ----------
#Ed May Sept 17, 2019

"""
Calculator for Psi-Value from THERM element (W/m-k)
    
    Args:
        _fullDetail_HL: The 'Full Detail' heat loss value. Connect to a 'Heat Loss' component. Input in (W/m)
        _clearfield_HL: A list of 'ClearField' heat loss values. Connect to a 'Heat Loss' component. Input in (W/m)
        _deltaT: Connect to the 'uFactorDeltaT' output pon the 'readTHERM' component to take in a list of U-factor temperature differeneces (deg. C).
    Returns:
        PsiValue_: [HeatLoss_detail - sum(HeatLoss_clearfields) / DeltaT ] Psi-Value Linear Heat Loss Coefficient. [W/m-k]
"""

# Calc the total of all the clearfiled HL items
clearfield_Total_HL = []
for hlItem in _clearfield_HL:
    clearfield_Total_HL.append(float(hlItem))

# Find the difference between the clearfield and the actual
PsiValue_ = (float(_fullDetail_HL) - sum(clearfield_Total_HL))/float(_deltaT)
# ---------- end psi_value ----------
psi_value_w_mk = Panel(psi_value.PsiValue)  # disabled
